# Grasshopper definition assignment_recursion02_boxes3d.gh (Grasshopper 1.0.7)

crv = Curve(<curve referenced from the Rhino model>)
python = PythonScript(line=crv, iterations=Slider(10, range=0..10))  # -> out, branches, boxes; inputs line: Line, iterations: Int32
# ---------- python: Python ----------
# this creates random branching lines with recursion
# input type: line
import Rhino.Geometry as rg
import random
import math

def recursiveLine(line, iterations, axis, lines, boxes):
    
    # count down the iterations
    # fill in here [...]
    
    # get the start and end points of the input line
    # fill in here [...]
    
    # get the vector of the input line, 2 times for the two branches
    # fill in here [...]
    
    # rotate the vectors 90° in positive and negative direction around 2 axes
    # fill in here [...]
    
    # for the scale, calculate a random scale between 0.7 and 0.8
    scale1 = random.uniform(0.7, 0.8)
    scale2 = random.uniform(0.7, 0.8)

    # and scale the vector according to the scale values
    # fill in here [...]
    
    # finally, create two new branches
    # fill in here [...]
    
    # and add them to the list of branches
    # fill in here [...]
   
    # create the normal vector using the cross product between the vector of the current line and dir1
    # fill in here [...]
    
    # and unitize the vector
    # fill in here [...]
    
    # calculate 4 corner points of the box
    pt1 = # fill in here [...]
    pt2 = # fill in here [...]
    pt3 = # fill in here [...]
    pt4 = # fill in here [...]
    
    # create a box around the lines
    box = rg.Box(rg.Plane.WorldYZ, [pt1, pt2, pt3, pt4])
    
    # and add them to the list of boxes
    # fill in here [...]
    
    # if the iteration is higher than zero, keep calling the function recursively
    if iterations > 0:
        if(random.random() < 0.9): # random omission
            # fill in here [...]
        if(random.random() < 0.9): # random omission
            #axis = rg.Vector3d.CrossProduct(line.Direction,dir2)
            # fill in here [...]


axis = rg.Vector3d.XAxis
branches = []
boxes = []

recursiveLine(line, iterations, axis, branches, boxes)
# ---------- end python ----------
line = Line(python.branches)
box = Box(python.boxes)
preview = CustomPreview(Geometry=box, Material=ColourSwatch(SwatchColor=RGB(255, 191, 191)))
