# Grasshopper definition viz_5_compas_ghpython.ghx (Grasshopper 1.0.7)

python = GhPythonScript(
    redraw=Button(),
    iterations=Slider(159, range=1..300),
    length_decrement=Slider(100, range=100..200),
    angle_increment=Slider(0.972, range=0.1..2))  # -> out, pts, pls; inputs iterations: Int32
# ---------- python: Python ----------
from random import random
from compas.geometry import pointcloud_xy
from compas.utilities import i_to_green
from compas.utilities import i_to_red

import compas_ghpython
from Rhino.Geometry import Circle
from Rhino.Geometry import Point3d, Plane, Vector3d

import math as m



def draw_triangles(len, length_decrement, angle, angle_increment, iterations, pts, pl):
    
    pt1x = len*m.cos(angle)
    pt1y = len*m.sin(angle)
    
    ang = m.radians(120)

    pt2x = m.cos(ang)*pt1x-m.sin(ang)*pt1y
    pt2y = m.sin(ang)*pt1x+m.cos(ang)*pt1y
    
    pt3x = m.cos(ang)*pt2x-m.sin(ang)*pt2y
    pt3y = m.sin(ang)*pt2x+m.cos(ang)*pt2y

    p1 = [pt1x, pt1y, 0]
    p2 = [pt2x, pt2y, 0]
    p3 = [pt3x, pt3y, 0]

    pts.append({'pos': p1, 'color': i_to_red(random())})
    pts.append({'pos': p2, 'color': i_to_red(random())})
    pts.append({'pos': p3, 'color': i_to_red(random())})
    
    pl.append({'points': [p1, p2, p3, p1]})
    
    if iterations-1>0:
        len -= len*length_decrement
        angle += angle_increment
        iterations -= 1
        draw_triangles(len, length_decrement, angle, angle_increment, iterations, pts, pl)

len=10
length_decrement=1/length_decrement
angle = m.radians(60)
angle_increment = m.radians(angle_increment)

pts = []
pl = []
draw_triangles(len, length_decrement, angle, angle_increment, iterations, pts, pl)

pts = compas_ghpython.draw_points(pts)
pls = compas_ghpython.draw_polylines(pl)
# ---------- end python ----------
pt = Point(python.pts)
crv = Curve(python.pls)
