# Grasshopper definition assignment_recursion01_branches2d3d.gh (Grasshopper 1.0.7)

crv = Curve(<curve referenced from the Rhino model>)
recursion2d = PythonScript(line=crv, iterations=Slider(10, range=1..10), make3D=Toggle(False))  # -> out, branches; inputs line: Line, iterations: Int32, make3D: Boolean
# ---------- recursion2d: Python ----------
# this creates random branching lines with recursion
# input type: line
import Rhino.Geometry as rg
import random
import math

def recursiveLine(line, iteration, branches):
    
    # count down the iterations
    # fill in here [...]
    
    # get the start and end points of the input line
    start_point = # fill in here [...]
    end_point = # fill in here [...]
    
    # get the vector of the input line, two times for the two branches
    dir1 = # fill in here [...]
    dir2 = # fill in here [...]
    
    # for the angle, calculate a random positive and negative angle between 0.1 and 0.5
    angle1 = random.uniform(0.1, 0.5)
    angle2 = random.uniform(-0.1, -0.5)
    
    # and rotate the vector along this angles in + and - direction
    # fill in here [...]
    
    # rotate also around the axis of the current line, to go into 3D
    if make3D == True:
        # fill in here [...]
        pass
    
    # for the scale, calculate a random scale between 0.9 and 1.0
    scale1 = random.uniform(0.9, 1.0)
    scale2 = random.uniform(0.9, 1.0)

    # and scale the vector according to the scale values
    # fill in here [...]
    
    # finally, create two new branches
    # fill in here [...]
    line1_start_point =  # fill in here [...]
    line1_end_point =  # fill in here [...]
    line2_start_point =  # fill in here [...]
    line2_end_point =  # fill in here [...]
    
    line1 = rg.Line(line1_start_point, line1_end_point)
    line2 = rg.Line(line2_start_point, line2_end_point)
    
    # and add them to the list of branches
    # fill in here [...]
    
    # if the iteration is higher than zero, keep calling the function recursively
    if iteration > 0:
        if(random.random()<0.9): # random omission
            # fill in here [...]
        if(random.random()<0.9): # random omission
            # fill in here [...]

branches = []
recursiveLine(line, iterations, branches)
# ---------- end recursion2d ----------
line = Line(recursion2d.branches)
preview = CustomPreview(Geometry=line, Material=ColourSwatch(SwatchColor=RGB(255, 191, 191)))
