# Grasshopper definition mesh_visualisation.ghx (Grasshopper 1.0.7)

mesh_viz = GhPythonScript()  # -> out, vertices, edges, faces, labels
# ---------- mesh_viz: Python ----------
import sys, os
import ghpythonlib.components as ghcomp
import compas
from compas.datastructures import Mesh
from compas_ghpython.artists import MeshArtist

ghComp = ghenv.Component
ghDoc = ghComp.OnPingDocument()
import Rhino.Geometry as rg

# the full path of the gh file
path_gh_file = ghDoc.FilePath

# the directory of the gh file
HERE = os.path.dirname(path_gh_file)
DATA = os.path.join(HERE, 'data')
FILE = os.path.join(DATA, 'faces.obj')

mesh = Mesh.from_obj(FILE)

artist = MeshArtist(mesh)
vertices = artist.draw_vertices()
edges = artist.draw_edges()
faces = artist.draw_faces()

labels = {key: key for key in mesh.vertices()}
# ---------- end mesh_viz ----------
mesh = Mesh(mesh_viz.faces)
pt = Point(mesh_viz.vertices)
line = Line(mesh_viz.edges)
tag = TextTag(Location=mesh_viz.vertices, Text=mesh_viz.labels)
