# Grasshopper definition network_visualisation.ghx (Grasshopper 1.0.7)

line = Line([Line((16.23840007, 5.480409529, 0), (19.53971621, 1.85027704, 0)), Line((19.53971621, 1.85027704, 0), (21.88088862, 5.440951567, 0)), Line((16.23840007, 5.480409529, 0), (21.88088862, 5.440951567, 0)), Line((16.23840007, 5.480409529, 0), (18.22445082, 8.926404863, 0)), Line((18.22445082, 8.926404863, 0), (21.88088862, 5.440951567, 0)), Line((18.22445082, 8.926404863, 0), (22.11763639, 9.439358367, 0))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])
network_viz = GhPythonScript(lines=line, key=Slider(0, range=0..6))  # -> out, nodes, edges, current_node, current_node_neighbors; inputs lines: list of Line, key: Int32
# ---------- network_viz: Python ----------
import sys, os
import ghpythonlib.components as ghcomp
import compas
from compas.datastructures import Network
from compas_ghpython.artists import NetworkArtist
from compas_rhino.geometry import RhinoLine

import compas_ghpython
import Rhino.Geometry as rg

ghComp = ghenv.Component
ghDoc = ghComp.OnPingDocument()

# the full path of the gh file
path_gh_file = ghDoc.FilePath

# the directory of the gh file
HERE = os.path.dirname(path_gh_file)
DATA = os.path.join(HERE, 'data')
FILE = os.path.join(DATA, 'lines.obj')


compas_lines = [RhinoLine.from_geometry(line).to_compas() for line in lines]
network = Network.from_lines(compas_lines)

def draw_network(network):
    """Draw a network in Grasshopper.
    """
    points = []
    for key, attr in network.nodes(True):
        points.append({
            'pos': network.node_coordinates(key),
        })

    lines = []
    for (u, v), attr in network.edges(True):
        lines.append({
            'start': network.node_coordinates(u),
            'end': network.node_coordinates(v),
        })

    points_rg = compas_ghpython.draw_points(points)
    lines_rg = compas_ghpython.draw_lines(lines)

    return points_rg, lines_rg

nodes, edges = draw_network(network)

current_node = {'pos': network.node_coordinates(key), 'radius': 0.5}
current_node = compas_ghpython.draw_spheres([current_node])


current_node_neighbors_keys = network.neighbors(key)
print current_node_neighbors_keys

current_node_neighbors = [{'pos': network.node_coordinates(key), 'radius': 0.4} for key in current_node_neighbors_keys]


current_node_neighbors = compas_ghpython.draw_spheres(current_node_neighbors)
# ---------- end network_viz ----------
network_viz_2 = GhPythonScript()  # -> out, nodes, edges
# ---------- network_viz_2: Python ----------
import sys, os
import ghpythonlib.components as ghcomp
import compas
from compas.datastructures import Network
from compas_ghpython.artists import NetworkArtist

import compas_ghpython

ghComp = ghenv.Component
ghDoc = ghComp.OnPingDocument()

# the full path of the gh file
path_gh_file = ghDoc.FilePath

# the directory of the gh file
HERE = os.path.dirname(path_gh_file)
DATA = os.path.join(HERE, 'data')
FILE = os.path.join(DATA, 'lines.obj')

network = Network.from_obj(FILE)

def draw_network(network):
    """Draw a network in Grasshopper.
    """
    points = []
    for key, attr in network.nodes(True):
        points.append({
            'pos': network.node_coordinates(key),
        })

    lines = []
    for (u, v), attr in network.edges(True):
        lines.append({
            'start': network.node_coordinates(u),
            'end': network.node_coordinates(v),
        })

    points_rg = compas_ghpython.draw_points(points)
    lines_rg = compas_ghpython.draw_lines(lines)

    return points_rg, lines_rg

nodes, edges = draw_network(network)
# ---------- end network_viz_2 ----------
line_2 = Line(network_viz_2.edges)
pt = Point(network_viz_2.nodes)
brep = Brep(network_viz.current_node_neighbors)
pt_2 = Point(network_viz.nodes)
line_3 = Line(network_viz.edges)
brep_2 = Brep(network_viz.current_node)
preview = CustomPreview(Geometry=brep_2, Material=ColourSwatch(SwatchColor=RGB(255, 48, 48)))
preview_2 = CustomPreview(Geometry=brep, Material=ColourSwatch(SwatchColor=RGB(255, 207, 207)))
