# Grasshopper definition 01_frame_and_transformation_rhino.gh (Grasshopper 1.0.7)

# ---- group: frames
python = GhPythonScript(ind=Slider(0, range=0..4))  # -> out, planeF
# ---------- python: Python ----------
"""There are several ways to construst a `Frame`.
"""
from compas.geometry import Point
from compas.geometry import Vector
from compas.geometry import Frame
from compas.geometry import Plane

from compas_ghpython import draw_frame

import Rhino.Geometry as rg

if ind == 0:
    F = Frame(Point(1, 0, 0), Vector(-0.45, 0.1, 0.3), Vector(1, 0, 0))
    print("Frame(Point(1, 0, 0), Vector(-0.45, 0.1, 0.3), Vector(1, 0, 0))")
elif ind == 1:
    F = Frame([1, 0, 0], [-0.45, 0.1, 0.3], [1, 0, 0])
    print("Frame([1, 0, 0], [-0.45, 0.1, 0.3], [1, 0, 0])")
elif ind == 2:
    F = Frame.from_points([1, 1, 1], [2, 3, 6], [6, 3, 0])
    print("Frame.from_points([1, 1, 1], [2, 3, 6], [6, 3, 0])")
elif ind == 3:
    F = Frame.from_plane(Plane([0, 0, 0], [0.5, 0.2, 0.1]))
    print("Frame.from_plane(Plane([0, 0, 0], [0.5, 0.2, 0.1]))")
elif ind == 4:
    F = Frame.from_euler_angles([0.5, 1., 0.2])
    print("Frame.from_euler_angles([0.5, 1., 0.2])")
elif ind == 5:
    F = Frame.worldXY()
    print("Frame.worldXY()")

print(F)

#planeF = rg.Plane(rg.Point3d(F[0][0], F[0][1], F[0][2]), rg.Vector3d(F[1][0], F[1][1], F[1][2]), rg.Vector3d(F[2][0], F[2][1], F[2][2]))
planeF = draw_frame(F)
# ---------- end python ----------
panel = Panel(python.out)

# ---- group: frame in frame
pt = Point(<point referenced from the Rhino model>)
crv = Curve(<curve referenced from the Rhino model>)
crv_2 = Curve(<curve referenced from the Rhino model>)
pt_2 = Point(<point referenced from the Rhino model>)
crv_3 = Curve(<curve referenced from the Rhino model>)
crv_4 = Curve(<curve referenced from the Rhino model>)
vec = Vector(crv)
vec_2 = Vector(crv_2)
vec_3 = Vector(crv_3)
vec_4 = Vector(crv_4)
python_2 = GhPythonScript(pt1=pt, vecx1=vec, vecy1=vec_2, pt2=pt_2, vecx2=vec_3, vecy2=vec_4)  # -> out, planef, planef2
# ---------- python_2: Python ----------
"""Example: 'frame in frame'
"""
from compas.geometry import Point
from compas.geometry import Vector
from compas.geometry import Frame

from compas_ghpython.utilities import draw_frame

import Rhino.Geometry as rg

#point = Point(146.00, 150.00, 161.50)
#xaxis = Vector(0.9767, 0.0010, -0.214)
#yaxis = Vector(0.1002, 0.8818, 0.4609)

point = pt1
xaxis = vecx1
yaxis = vecy1

# coordinate system F
F = Frame(point, xaxis, yaxis)

# frame f in F (local coordinates)
#point = Point(35., 35., 35.)
#xaxis = Vector(0.604, 0.430, 0.671)
#yaxis = Vector(-0.631, 0.772, 0.074)
point = pt2
xaxis = vecx2
yaxis = vecy2
f = Frame(point, xaxis, yaxis)

# frame in global (world) coordinate system
f_ = F.represent_frame_in_global_coordinates(f)
print(f_)
planef_ = draw_frame(f_)
# check
f2 = F.represent_frame_in_local_coordinates(f_)
print(f2)
planef2 = draw_frame(f2)

print(f == f2)
# ---------- end python_2 ----------
pln = Plane(python_2.planef2)
pln_2 = Plane(python_2.planef)

# ---- group: frames as coordinate systems
pt_3 = Point(<point referenced from the Rhino model>)
crv_5 = Curve(<curve referenced from the Rhino model>)
crv_6 = Curve(<curve referenced from the Rhino model>)
vec_5 = Vector(crv_5)
vec_6 = Vector(crv_6)
python_3 = GhPythonScript(pt1=pt_3, vecx=vec_5, vecy=vec_6)  # -> out, pt_n1, pt_n2
# ---------- python_3: Python ----------
"""Example: 'point in frame'
"""
from compas.geometry import Point
from compas.geometry import Vector
from compas.geometry import Frame
from compas_ghpython.utilities import draw_points

import Rhino.Geometry as rg

print pt1

#point = Point(147.00, 150.00, 161.50)
point = pt1
#xaxis = Vector(0.9767, 0.0010, -0.214)
#yaxis = Vector(0.1002, 0.8818, 0.4609)
xaxis = vecx
yaxis = vecy

# coordinate system F
F = Frame(point, xaxis, yaxis)

# point in F (local coordinates)
P = Point(15., 15., 15.)

# point in global (world) coordinates
P_ = F.represent_point_in_global_coordinates(P)
print(P_)
pt_n1 = rg.Point3d(P_[0], P_[1], P_[2])

# check
P2 = F.represent_point_in_local_coordinates(P_)
pt_n2 = rg.Point3d(P2[0], P2[1], P2[2])
# ---------- end python_3 ----------
pt_4 = Point(python_3.pt_n2)
pt_5 = Point(python_3.pt_n1)

# ---- group: transform box from frae to frame
pt_6 = Point(<point referenced from the Rhino model>)
crv_7 = Curve(<curve referenced from the Rhino model>)
crv_8 = Curve(<curve referenced from the Rhino model>)
pt_7 = Point(<point referenced from the Rhino model>)
crv_9 = Curve(<curve referenced from the Rhino model>)
crv_10 = Curve(<curve referenced from the Rhino model>)
vec_7 = Vector(crv_7)
vec_8 = Vector(crv_8)
vec_9 = Vector(crv_9)
vec_10 = Vector(crv_10)
python_4 = GhPythonScript(pt1=pt_6, vecx1=vec_7, vecy1=vec_8, pt2=pt_7, vecx2=vec_9, vecy2=vec_10)  # -> out, box_init, box_transf
# ---------- python_4: Python ----------
"""Example: Bring a box from the world coordinate system into another coordinate system.
"""
from compas.geometry import Frame
from compas.geometry import Transformation
from compas.geometry import Box

from compas_ghpython.artists import MeshArtist
from compas.datastructures.mesh import Mesh
import Rhino.Geometry as rg



# Box in the world coordinate system
#frame = Frame([1, 0, 0], [-0.45, 0.1, 0.3], [1, 0, 0])
frame = Frame(pt1, vecx1, vecy1)
width, length, height = 10, 10, 10
box = Box(frame, width, length, height)
mesh = Mesh.from_vertices_and_faces(box.vertices, box.faces)
m_b1 = MeshArtist(mesh)
box_init = m_b1.draw()

# Frame F representing a coordinate system
#F = Frame([2, 2, 2], [0.978, 0.010, -0.210], [0.090, 0.882, 0.463])
F = Frame(pt2, vecx2, vecy2)

# Represent box frame in frame F and costruct new box
box_frame_transformed = F.represent_frame_in_global_coordinates(box.frame)
box_transformed = Box(box_frame_transformed, width, length, height)
print("Box frame transformed", box_transformed.frame)

mesh = Mesh.from_vertices_and_faces(box_transformed.vertices, box_transformed.faces)
m_b2 = MeshArtist(mesh)
box_transf = m_b2.draw()
# ---------- end python_4 ----------
mesh = Mesh(python_4.box_transf)
mesh_2 = Mesh(python_4.box_init)

# ---- group: transformation between two frames
pt_8 = Point(<point referenced from the Rhino model>)
crv_11 = Curve(<curve referenced from the Rhino model>)
crv_12 = Curve(<curve referenced from the Rhino model>)
pt_9 = Point(<point referenced from the Rhino model>)
crv_13 = Curve(<curve referenced from the Rhino model>)
crv_14 = Curve(<curve referenced from the Rhino model>)
vec_11 = Vector(crv_13)
vec_12 = Vector(crv_14)
vec_13 = Vector(crv_11)
vec_14 = Vector(crv_12)
python_5 = GhPythonScript(pt1=pt_8, vecx1=vec_13, vecy1=vec_14, pt2=pt_9, vecx2=vec_11, vecy2=vec_12)  # -> out, a
# ---------- python_5: Python ----------
"""This example computes a change of basis transformation between two frames F1 and F2.
A basis change is essentially a remapping of geometry from one coordinate system to another.
"""
from compas.geometry import Frame
from compas.geometry import Transformation

#F1 = Frame([2, 2, 2], [0.12, 0.58, 0.81], [-0.80, 0.53, -0.26])
#F2 = Frame([1, 1, 1], [0.68, 0.68, 0.27], [-0.67, 0.73, -0.15])

F1 = Frame(pt1, vecx1, vecy1)
F2 = Frame(pt2, vecx2, vecy2)

T = Transformation.from_frame_to_frame(F1, F2)

print T
# ---------- end python_5 ----------
panel_2 = Panel(python_5.out)

# ---- group: transform box using T
pt_10 = Point(<point referenced from the Rhino model>)
crv_15 = Curve(<curve referenced from the Rhino model>)
crv_16 = Curve(<curve referenced from the Rhino model>)
pt_11 = Point(<point referenced from the Rhino model>)
crv_17 = Curve(<curve referenced from the Rhino model>)
crv_18 = Curve(<curve referenced from the Rhino model>)
vec_15 = Vector(crv_15)
vec_16 = Vector(crv_16)
vec_17 = Vector(crv_17)
vec_18 = Vector(crv_18)
python_6 = GhPythonScript(pt1=pt_10, vecx1=vec_15, vecy1=vec_16, pt2=pt_11, vecx2=vec_17, vecy2=vec_18)  # -> out, box_init, box_transf
# ---------- python_6: Python ----------
"""Example: Bring a box from the world coordinate system into another coordinate system.
"""
from compas.geometry import Frame
from compas.geometry import Transformation
from compas.geometry import Box
from compas.datastructures.mesh import Mesh
from compas_ghpython.artists import MeshArtist


# Box in the world coordinate system
frame = Frame(pt1, vecx1, vecy1)
width, length, height = 10, 10, 10
box = Box(frame, width, length, height)
mesh = Mesh.from_vertices_and_faces(box.vertices, box.faces)
m_b1 = MeshArtist(mesh)
box_init = m_b1.draw()

# Frame F representing a coordinate system
#F = Frame([2, 2, 2], [0.978, 0.010, -0.210], [0.090, 0.882, 0.463])
F = Frame(pt2, vecx2, vecy2)

# Get transformation between frames and apply transformation on box.
T = Transformation.from_frame_to_frame(Frame.worldXY(), F)
box_transformed = box.transformed(T)
print("Box frame transformed", box_transformed.frame)
mesh = Mesh.from_vertices_and_faces(box_transformed.vertices, box_transformed.faces)
m_b2 = MeshArtist(mesh)
box_transf = m_b2.draw()
# ---------- end python_6 ----------
mesh_3 = Mesh(python_6.box_transf)
mesh_4 = Mesh(python_6.box_init)

# ---- group: euler and axis angles
gamma = Slider(-3.14, range=-3.14..3.14)
python_7 = GhPythonScript(alpha=Slider(-3.14, range=-3.14..3.14), beta=Slider(-3.14, range=-3.14..3.14), gamma=gamma)  # -> out, plane, box_transf
# ---------- python_7: Python ----------
"""Example: Rotations from euler angles, rotate an object based on 3 euler angles.
"""

import compas
from compas.geometry import Frame
from compas.geometry import Rotation
from compas.datastructures import Mesh
from compas.datastructures import mesh_transform
from compas.geometry import Box
from compas_ghpython.utilities import draw_frame
from compas_ghpython.artists import MeshArtist

# euler angles
#alpha, beta, gamma = -0.156, -0.274, 0.785
static, axes = True, 'xyz'

# Version 1: Create Rotation from angles
R1 = Rotation.from_euler_angles([alpha, beta, gamma], static, axes)

# Version 2: Concatenate 3 Rotations
xaxis, yaxis, zaxis = [1, 0, 0], [0, 1, 0], [0, 0, 1]
Rx = Rotation.from_axis_and_angle(xaxis, alpha)
Ry = Rotation.from_axis_and_angle(yaxis, beta)
Rz = Rotation.from_axis_and_angle(zaxis, gamma)
 
if static: # check order!
    R2 = Rz * Ry * Rx
else:
    R2 = Rx * Ry * Rz

# Check
print(R1 == R2)

# Transform box
box = Box.from_width_height_depth(10, 10, 10)
box.transform(R1)

F = box.frame
plane = draw_frame(F)

mesh = Mesh.from_vertices_and_faces(box.vertices, box.faces)
m_b = MeshArtist(mesh)
box_transf = m_b.draw()
# ---------- end python_7 ----------

theta = Slider(0.64, range=-3.14..3.14)
pt_12 = Point(<point referenced from the Rhino model>)
crv_19 = Curve(<curve referenced from the Rhino model>)
crv_20 = Curve(<curve referenced from the Rhino model>)
vec_19 = Vector(crv_19)
vec_20 = Vector(crv_20)
python_8 = GhPythonScript(pt1=pt_12, vecx=vec_19, vecy=vec_20, theta=theta)  # -> out, plane, box_transf
# ---------- python_8: Python ----------
"""Example: Rotations from axis angle representation, rotate an object based on 3 euler angles.
"""

import math
from compas.geometry import Frame
from compas.geometry import Rotation
from compas.geometry import Box
from compas.datastructures.mesh import Mesh
from compas_ghpython.utilities import draw_frame
from compas_ghpython.artists import MeshArtist

#theta = math.radians(30)
R = Rotation.from_axis_and_angle((1,0,0), theta)
#print(R)

f1 = Frame(pt1, vecx, vecy)
R = Rotation.from_frame(f1)

args = False, 'xyz'
alpha, beta, gamma = R.euler_angles(*args)
print("euler angles = ", alpha, beta, gamma)
xaxis, yaxis, zaxis = [1, 0, 0], [0, 1, 0], [0, 0, 1]
Rx = Rotation.from_axis_and_angle(xaxis, alpha)
Ry = Rotation.from_axis_and_angle(yaxis, beta)
Rz = Rotation.from_axis_and_angle(zaxis, gamma)
f2 = Frame.worldXY()
#f1 == f2.transform(Rx * Ry * Rz)

# Transform box
box = Box.from_width_height_depth(10, 10, 10)
box.transform(Rx * Ry * Rz)

F = box.frame
plane = draw_frame(f1)

mesh = Mesh.from_vertices_and_faces(box.vertices, box.faces)
m_b = MeshArtist(mesh)
box_transf = m_b.draw()
# ---------- end python_8 ----------
panel_3 = Panel(python_8.out)

# ---- group: quaternions
q4 = Slider(0, range=-1..1)
python_9 = GhPythonScript(q1=Slider(1, range=-1..1), q2=Slider(0, range=-1..1), q3=Slider(0, range=-1..1), q4=q4)  # -> out, plane, box_transf
# ---------- python_9: Python ----------
"""Example: Rotations from quaternion representation.
"""

import math
from compas.geometry import Frame
from compas.geometry import Rotation
from compas.geometry import Box
from compas.datastructures.mesh import Mesh
from compas_ghpython.utilities import draw_frame
from compas_ghpython.artists import MeshArtist


# Quaternion input for the Rotation matrix
quaternion_a = [q1, q2, q3, q4]
R = Rotation.from_quaternion(quaternion_a)

# The basis vectors from the Rotation matrix
xaxis, yaxis = R.basis_vectors
print(xaxis)
print(yaxis)

# A frame created with the basis vectors of 
f1 = Frame([0,0,0], xaxis, yaxis)
R = Rotation.from_frame(f1)

quaternion_b = R.quaternion
print(quaternion_b)

print("quaternion_a ==", [round(val, 3) for val in quaternion_b])

# Transform box
box = Box.from_width_height_depth(10, 10, 10)
box.transform(R)

F = box.frame
plane = draw_frame(F)

mesh = Mesh.from_vertices_and_faces(box.vertices, box.faces)
m_b = MeshArtist(mesh)
box_transf = m_b.draw()
# ---------- end python_9 ----------
