# Grasshopper definition mesh_visualisation.gh (Grasshopper 1.0.7)

mesh_viz = GhPythonScript()  # -> out, vertices, edges, faces
# ---------- mesh_viz: Python ----------
import sys, os
import ghpythonlib.components as ghcomp
import compas
from compas.datastructures import Mesh
from compas_ghpython.artists import MeshArtist

ghComp = ghenv.Component
ghDoc = ghComp.OnPingDocument()

# the full path of the gh file
path_gh_file = ghDoc.FilePath

# the directory of the gh file
HERE = os.path.dirname(path_gh_file)
DATA = os.path.join(HERE, 'data')
FILE = os.path.join(DATA, 'faces.obj')

mesh = Mesh.from_obj(FILE)

artist = MeshArtist(mesh)
vertices = artist.draw_vertices()
edges = artist.draw_edges()
faces = artist.draw_faces()
# ---------- end mesh_viz ----------
pt = Point(mesh_viz.vertices)
line = Line(mesh_viz.edges)
mesh = Mesh(mesh_viz.faces)
