# Grasshopper definition 01_frame_and_transformation_rhino.gh (Grasshopper 1.0.7)

pt = Point(<point referenced from the Rhino model>)
crv = Curve(<curve referenced from the Rhino model>)
crv_2 = Curve(<curve referenced from the Rhino model>)
pt_2 = Point(<point referenced from the Rhino model>)
crv_3 = Curve(<curve referenced from the Rhino model>)
crv_4 = Curve(<curve referenced from the Rhino model>)
pt_3 = Point(<point referenced from the Rhino model>)
crv_5 = Curve(<curve referenced from the Rhino model>)
crv_6 = Curve(<curve referenced from the Rhino model>)
vec = Vector(crv)
vec_2 = Vector(crv_2)
vec_3 = Vector(crv_3)
vec_4 = Vector(crv_4)
vec_5 = Vector(crv_5)
vec_6 = Vector(crv_6)
python = GhPythonScript(ind=Slider(0, range=0..4))  # -> out, planeF
# ---------- python: Python ----------
"""There are several ways to construst a `Frame`.
"""
from compas.geometry import Point
from compas.geometry import Vector
from compas.geometry import Frame
from compas.geometry import Plane

import Rhino.Geometry as rg

if ind == 0:
    F = Frame(Point(1, 0, 0), Vector(-0.45, 0.1, 0.3), Vector(1, 0, 0))
    print("Frame(Point(1, 0, 0), Vector(-0.45, 0.1, 0.3), Vector(1, 0, 0))")
elif ind == 1:
    F = Frame([1, 0, 0], [-0.45, 0.1, 0.3], [1, 0, 0])
    print("Frame([1, 0, 0], [-0.45, 0.1, 0.3], [1, 0, 0])")
elif ind == 2:
    F = Frame.from_points([1, 1, 1], [2, 3, 6], [6, 3, 0])
    print("Frame.from_points([1, 1, 1], [2, 3, 6], [6, 3, 0])")
elif ind == 3:
    F = Frame.from_plane(Plane([0, 0, 0], [0.5, 0.2, 0.1]))
    print("Frame.from_plane(Plane([0, 0, 0], [0.5, 0.2, 0.1]))")
elif ind == 4:
    F = Frame.from_euler_angles([0.5, 1., 0.2])
    print("Frame.from_euler_angles([0.5, 1., 0.2])")
elif ind == 5:
    F = Frame.worldXY()
    print("Frame.worldXY()")

print(F)

planeF = rg.Plane(rg.Point3d(F[0][0], F[0][1], F[0][2]), rg.Vector3d(F[1][0], F[1][1], F[1][2]), rg.Vector3d(F[2][0], F[2][1], F[2][2]))
# ---------- end python ----------
python_2 = GhPythonScript(pt1=pt_3, vecx=vec_5, vecy=vec_6)  # -> out, pt_n1, pt_n2
# ---------- python_2: Python ----------
"""Example: 'point in frame'
"""
from compas.geometry import Point
from compas.geometry import Vector
from compas.geometry import Frame
from compas_ghpython.utilities import draw_points

import Rhino.Geometry as rg

print pt1

#point = Point(147.00, 150.00, 161.50)
point = pt1
#xaxis = Vector(0.9767, 0.0010, -0.214)
#yaxis = Vector(0.1002, 0.8818, 0.4609)
xaxis = vecx
yaxis = vecy

# coordinate system F
F = Frame(point, xaxis, yaxis)

# point in F (local coordinates)
P = Point(15., 15., 15.)

# point in global (world) coordinates
P_ = F.represent_point_in_global_coordinates(P)
print(P_)
#pt_n1 = rg.Point3d(P_[0], P_[1], P_[2])

# check
P2 = F.represent_point_in_local_coordinates(P_)
pt_n2 = rg.Point3d(P2[0], P2[1], P2[2])
# ---------- end python_2 ----------
python_3 = GhPythonScript()  # -> out, a
# ---------- python_3: Python ----------
"""Example: Bring a box from the world coordinate system into another coordinate system.
"""
from compas.geometry import Frame
from compas.geometry import Transformation
from compas.geometry import Box

from compas_ghpython.artists import MeshArtist

# Box in the world coordinate system
frame = Frame([1, 0, 0], [-0.45, 0.1, 0.3], [1, 0, 0])
width, length, height = 1, 1, 1
box = Box(frame, width, length, height)


# Frame F representing a coordinate system
F = Frame([2, 2, 2], [0.978, 0.010, -0.210], [0.090, 0.882, 0.463])

# Represent box frame in frame F and costruct new box
box_frame_transformed = F.represent_frame_in_global_coordinates(box.frame)
box_transformed = Box(box_frame_transformed, width, length, height)
print("Box frame transformed", box_transformed.frame)
# ---------- end python_3 ----------
python_4 = GhPythonScript(pt1=pt, vecx1=vec, vecy1=vec_2, pt2=pt_2, vecx2=vec_3, vecy2=vec_4)  # -> out, planef, planef2
# ---------- python_4: Python ----------
"""Example: 'frame in frame'
"""
from compas.geometry import Point
from compas.geometry import Vector
from compas.geometry import Frame

from compas_ghpython.utilities import draw_frame

import Rhino.Geometry as rg

#point = Point(146.00, 150.00, 161.50)
#xaxis = Vector(0.9767, 0.0010, -0.214)
#yaxis = Vector(0.1002, 0.8818, 0.4609)

point = pt1
xaxis = vecx1
yaxis = vecy1

# coordinate system F
F = Frame(point, xaxis, yaxis)

# frame f in F (local coordinates)
#point = Point(35., 35., 35.)
#xaxis = Vector(0.604, 0.430, 0.671)
#yaxis = Vector(-0.631, 0.772, 0.074)
point = pt2
xaxis = vecx2
yaxis = vecy2
f = Frame(point, xaxis, yaxis)

# frame in global (world) coordinate system
f_ = F.represent_frame_in_global_coordinates(f)
print(f_)
planef_ = draw_frame(f_)
# check
f2 = F.represent_frame_in_local_coordinates(f_)
print(f2)
planef2 = draw_frame(f2)

print(f == f2)
# ---------- end python_4 ----------
panel = Panel(python.out)
pt_4 = Point(python_2.pt_n1)
pt_5 = Point(python_2.pt_n2)
pln = Plane(python_4.planef2)
pln_2 = Plane(python_4.planef)
